# Requirement set LiveDoc_Lambda FuelRateController Specifications_Fault Tolerant Fuel System Architecture Requirements Specification (R2022a)

Attributes:
- PolarionConnector: value from linktype_rmi_polarion
- rev: value from linktype_rmi_polarion

## 1 [https://lambda-latest.net.plm.eds.com/polarion/#/project/FuelRateController/wiki/Specifications/Fault Tolerant Fuel System Architecture Requirements Specification] References to Fault Tolerant Fuel System Architecture Requirements Specification (Container)
Read-only references to Polarion Workitem document.

### 1.1 [FRC-141] Main Sub Systems (Container)
PolarionConnector: N/A
rev: 12564

#### 1.1.1 [FRC-167] Airflow (Container)
PolarionConnector: N/A
rev: 12430

##### 1.1.1.1 [FRC-143] Mass airflow estimation (Airflow calculation) ***UPDATED***
The controller will use engine speed, throttle position and manifold pressure to estimate the mass airflow through the engine.
| Engine AirFlow (kg/h) | Engine Speed (rpm) |
| 8 | 500 |
| 11 | 1000 |
| 18 | 1500 |
| 23 | 2000 |
| 29 | 2500 |
PolarionConnector: N/A
rev: 13348

#### 1.1.2 [FRC-170] Sensor Correction and Fault Redundancy (Container)
PolarionConnector: N/A
rev: 12947

##### 1.1.2.1 [FRC-151] Fault Redundancy
The controller shall provide fault redundancy monitoring and failure detection when operating.
PolarionConnector: N/A
rev: 12310

##### 1.1.2.2 [FRC-262] New requirement
PolarionConnector: N/A
rev: 12947

#### 1.1.3 [FRC-168] Pumping Constant (Container)
PolarionConnector: N/A
rev: 12123

##### 1.1.3.1 [FRC-145] Determination of pumping efficiency (Pumping Constant)
The airflow calculation will use a calibratable table to determine the pumping efficiency of the engine based on engine speed and manifold pressure.
PolarionConnector: N/A
rev: 12309

#### 1.1.4 [FRC-171] Airflow Integrator (Container)
PolarionConnector: N/A
rev: 12123

##### 1.1.4.1 [FRC-147] Adjustment of estimated airflow (Airflow calculation/Integrator)
The fuel system will use an exhaust gas oxygen sensor to adjust the estimated airflow
PolarionConnector: N/A
rev: 12454

#### 1.1.5 [FRC-169] Failure Control Vector (Container)
PolarionConnector: N/A
rev: 12123

##### 1.1.5.1 [FRC-149] Failure Control Vector
The controller shall provide access to the internal vector of failure flags that indicate what sensors are in a failure condition.
PolarionConnector: N/A
rev: 12454

### 1.2 [FRC-152] Failure Management Subsystem (Container)
PolarionConnector: N/A
rev: 12123

#### 1.2.1 [FRC-173] Fault monitoring and detection (Container)
PolarionConnector: N/A
rev: 12476

##### 1.2.1.1 [FRC-153] Fault Monitoring
The fuel rate controller logic shall monitor faults relating too O2 oxygen, Manifold Pressure and Throttle sensors.
PolarionConnector: N/A
rev: 13203

##### 1.2.1.2 [FRC-165] Fault Detection
The system shall be able to detect if one or multiple sensors fail.
PolarionConnector: N/A
rev: 12454

##### 1.2.1.3 [FRC-155] Oxygen sensor disabled during warmup
During a calibratable warm up period the oxygen sensor correction will be disabled.
PolarionConnector: N/A
rev: 12454

##### 1.2.1.4 [FRC-157] Enriched mixture usage
The fuel system will use an enriched mixture whenever a sensor has failed.
PolarionConnector: N/A
rev: 12454

#### 1.2.2 [FRC-172] Disable Fuel system (Container)
| Property Name | Property Value |
| Parameters | |
| Path | FuelSysWithReqLinks/fuel rate controller/control logic/Fueling_Mode |
| Id | 70 |
| SSIdNumber | 22 |
| Name | Fuel_Disabled |
| Description | The fuel is completely shut off while in this state. |
| LabelString | Fuel_Disabled entry: fuel_mode = DISABLED |
| FontSize | 13.54 |
| ArrowSize | 12 |
| TestPoint | false |
| BadIntersection | false |
| Document | |
| Tag | |
| RequirementInfo | |
| ExecutionOrder | 0 |
| ContentPreviewEnabled | false |
| Position | 676.05 595.258 241.534 298.801 |
| Decomposition | EXCLUSIVE_OR |
| Type | OR |
| IsSubchart | false |
| IsGrouped | false |
| InlineOption | Auto |
| HasOutputData | false |
| OutputData | |
| OutputMonitoringMode | ChildActivity |
| IsExplicitlyCommented | false |
| IsImplicitlyCommented | false |
| CommentText | |
PolarionConnector: N/A
rev: 12947

##### 1.2.2.1 [FRC-161] Disable fuel system due to sensor failure
The fuel system will disable fuel when two or more sensors have failed to prevent the possibility of fire.
PolarionConnector: N/A
rev: 12454

##### 1.2.2.2 [FRC-163] Disable fuel system due to engine speed
The fuel system will disable fuel whenever the engine speed exceeds the calibratable threshold.
PolarionConnector: N/A
rev: 13207